# Grasshopper definition ejercicio10_s2_FabLabUNI.gh (Grasshopper 1.0.7)

crv = Curve(<curve referenced from the Rhino model>)
divide = DivideCurve(Curve=crv, Count=Slider(100, range=0..100), Kinks=False)  # -> Points, Tangents, Parameters
pline = PolyLine(Vertices=divide.Points, Closed=crv)
patch = Patch(Curves=pline, Spans=20, Flexibility=1, Trim=True)
popgeo = PopulateGeometry(Geometry=patch, Count=Slider(80, range=0..100), Seed=Slider(2, range=0..100))
voronoi³ = Voronoi3D(Points=popgeo)  # -> Cells, Boundary
bbx = BrepBrep(BrepA=patch, BrepB=voronoi³.Cells)  # -> Curves, Points
disc = Discontinuity(Curve=bbx.Curves, Level=1)  # -> Points, Parameters
pline_2 = PolyLine(Vertices=disc.Points, Closed=False)
