# Grasshopper definition ejercicio2_s2_FabLabUNI.gh (Grasshopper 1.0.7)

addition = Addition(A="5", B="6")
multiplication = Multiplication(A="5", B="6")
division = Division(A="13", B="6")
panel = Panel(multiplication)
panel_2 = Panel(division)
panel_3 = Panel(addition)
pow = Power(A="2", B="6")
integer_division = IntegerDivision(A="13", B="6")
mod = Modulus(A="13", B="6")
panel_4 = Panel(pow)
panel_5 = Panel(integer_division)
panel_6 = Panel(mod)
smaller = SmallerThan(FirstNumber="5", SecondNumber="6")  # -> SmallerThan, OrEqualTo
larger = LargerThan(FirstNumber="6", SecondNumber="6")  # -> LargerThan, OrEqualTo
panel_7 = Panel(smaller.OrEqualTo)
panel_8 = Panel(smaller.SmallerThan)
panel_9 = Panel(larger.OrEqualTo)
panel_10 = Panel(larger.LargerThan)
not = GateNot(A=panel_8)
panel_11 = Panel(not)
