# Grasshopper definition ejercicio6_s2_FabLabUNI.gh (Grasshopper 1.0.7)

number_slider = Slider(8.4, range=0..20)
number_slider_2 = Slider(15, range=0..20)
multiplication = Multiplication(A=Slider(7, range=0..15), B=number_slider)
multiplication_2 = Multiplication(A=Slider(8, range=0..15), B=number_slider)
number_slider_3 = Slider(60, range=0..100)
recgrid = Rectangular(Plane=PlaneXY(0, 0, 0), SizeX=number_slider, SizeY=number_slider, ExtentX=number_slider_2, ExtentY=number_slider_2)  # -> Cells, Points
pt = ConstructPoint(XCoordinate=multiplication_2, YCoordinate=multiplication, ZCoordinate=0)
cir = Circle(Plane=pt, Radius=number_slider_3)
cir_2 = Circle(Plane=recgrid.Points, Radius=Slider(4, range=0..10))
panel = Panel(recgrid.Points)
dist = Distance(PointA=cir_2, PointB=cir)
min = Minimum(A=dist, B=number_slider_3)
division = Division(A=min, B=number_slider_3)
scale = Scale(Geometry=cir_2, Center=cir_2, Factor=division)  # -> Geometry, Transform
