# Grasshopper definition ejercicio7_s2_FabLabUNI.gh (Grasshopper 1.0.7)

pt = Point([<point referenced from the Rhino model> x24])
pt_2 = Point([<point referenced from the Rhino model> x12])
crv = Curve(<curve referenced from the Rhino model>)
voronoi³ = Voronoi3D(Points=pt)  # -> Cells, Boundary
voronoi = Voronoi(Points=pt_2, Radius=Slider(9.643, range=0..40), Boundary=crv, BruteForceOverride=False)
