# Grasshopper definition ejercicio8_s2_FabLabUNI.gh (Grasshopper 1.0.7)

pt = Point(<point referenced from the Rhino model>)
X = UnitX(Factor=Slider(166, range=0..1000))
arrlinear = LinearArray(Geometry=pt, Direction=X, Count=Slider(102, range=0..1000))  # -> Geometry, Transform
pdecon = Deconstruct(Point=arrlinear.Geometry)  # -> XComponent, YComponent, ZComponent
expression = Expression(x=pdecon.XComponent, Expression="x*cos(x)")
expression_2 = Expression(x=pdecon.XComponent, Expression="x*sin(x)")
pt_2 = ConstructPoint(XCoordinate=expression_2, YCoordinate=expression, ZCoordinate=0)
voronoi = Voronoi(Points=pt_2, Radius=Slider(3832, range=0..10000), BruteForceOverride=False)
Z = UnitZ(Factor=Slider(1000, range=0..1000))
boundary = BoundarySurfaces(Edges=voronoi)
extr = Extrude(Base=voronoi, Direction=Z)
geo = Geometry([boundary, extr])
