# Grasshopper definition ejercicio2_s1_FabLabUNI.gh (Grasshopper 1.0.7)

pt = Point(<point referenced from the Rhino model>)
pdecon = Deconstruct(Point=pt)  # -> XComponent, YComponent, ZComponent
panel = Panel(pdecon.YComponent)
panel_2 = Panel(pdecon.ZComponent)
panel_3 = Panel(pdecon.XComponent)
