# Grasshopper definition ejercicio3_s1_FabLabUNI.gh (Grasshopper 1.0.7)

pt = ConstructPoint(XCoordinate=Slider(5.937, range=0..10), YCoordinate=Slider(8.074, range=0..10), ZCoordinate=Slider(9.702, range=0..10))
pt_2 = ConstructPoint(XCoordinate=Slider(1.993, range=0..10), YCoordinate=Slider(2.226, range=0..10), ZCoordinate=Slider(3.718, range=0..10))
dist = Distance(PointA=pt, PointB=pt_2)
recgrid = Rectangular(
    Plane=PlaneXY(0, 0, 0),
    SizeX=Slider(2, range=0..10),
    SizeY=Slider(7, range=0..10),
    ExtentX=Slider(7, range=0..10),
    ExtentY=Slider(4, range=0..10))  # -> Cells, Points
panel = Panel(dist)
