# Grasshopper definition ejercicio4_s1_FabLabUNI.gh (Grasshopper 1.0.7)

pt = ConstructPoint(XCoordinate=Slider(0, range=0..20), YCoordinate=Slider(0, range=0..20), ZCoordinate=Slider(0, range=0..20))
pt_2 = ConstructPoint(XCoordinate=Slider(0, range=0..20), YCoordinate=Slider(15, range=0..20), ZCoordinate=Slider(0, range=0..20))
pt_3 = ConstructPoint(XCoordinate=Slider(5, range=0..20), YCoordinate=Slider(0, range=0..20), ZCoordinate=Slider(0, range=0..20))
pt_4 = ConstructPoint(XCoordinate=Slider(5, range=0..20), YCoordinate=Slider(20, range=0..20), ZCoordinate=Slider(0, range=0..20))
ln = Line(StartPoint=pt, EndPoint=pt_2)
ln_2 = Line(StartPoint=pt_3, EndPoint=pt_4)
panel = Panel("""1
2
3""")
panel_2 = Panel("""A
B
C""")
panel_3 = Panel("""A
B
C
D
E
F
G""")
divide = DivideCurve(Curve=ln, Count=Slider(6, range=1..10), Kinks=False)  # -> Points, Tangents, Parameters
divide_2 = DivideCurve(Curve=ln_2, Count=Slider(8, range=1..10), Kinks=False)  # -> Points, Tangents, Parameters
lng = ListLength(List=panel_2)
item = ListItem(List=panel_2, Index="2", Wrap=True)
split = SplitList(List=panel_3, Index="4")  # -> ListA, ListB
ins = InsertItems(List=panel, Item="9", Indices="1", Wrap=True)
panel_4 = Panel(divide.Points)
panel_5 = Panel(divide_2.Points)
panel_6 = Panel(lng)
panel_7 = Panel(item)
index = ItemIndex(List=panel_2, Item=item)
panel_8 = Panel(split.ListA)
panel_9 = Panel(split.ListB)
panel_10 = Panel(ins)
panel_11 = Panel(index)
short = ShortestList(ListA=panel_4, ListB=panel_5, TrimMode=3)  # -> ListA, ListB
rev = ReverseList(List=panel_9)
ln_3 = Line(StartPoint=short.ListA, EndPoint=short.ListB)
panel_12 = Panel(rev)
panel_13 = Panel("""1
2
3""")
panel_14 = Panel("""A
B
C""")
panel_15 = Panel("""1
2
3""")
panel_16 = Panel("""1
2
3""")
panel_17 = Panel("""A
B
C""")
panel_18 = Panel("""A
B
C""")
crossref = CrossReference(ListA=panel_13, ListB=panel_14, CrossMode=4)  # -> ListA, ListB
crossref_2 = CrossReference(ListA=panel_15, ListB=panel_17, CrossMode=2)  # -> ListA, ListB
crossref_3 = CrossReference(ListA=panel_16, ListB=panel_18, CrossMode=1)  # -> ListA, ListB
panel_19 = Panel(crossref.ListB)
panel_20 = Panel(crossref.ListA)
panel_21 = Panel(crossref_2.ListB)
panel_22 = Panel(crossref_2.ListA)
panel_23 = Panel(crossref_3.ListB)
panel_24 = Panel(crossref_3.ListA)
