# Grasshopper definition ejercicio1_s2_FabLabUNI.gh (Grasshopper 1.0.7)

int = Integer(0)
series = Series(Start=int, Step=Slider(1, range=0..5), Count="8")
panel = Panel(series)
multiplication = Multiplication(A=panel, B=Slider(5, range=0..10))
addition = Addition(A=panel, B=Slider(5, range=0..10))
pi = Pi(Factor=panel)
panel_2 = Panel(addition)
panel_3 = Panel(pi)
cos = Cosine(Value=panel_3)
panel_4 = Panel(cos)
multiplication_2 = Multiplication(A=panel_4, B="5")
panel_5 = Panel(multiplication_2)
pt = ConstructPoint(XCoordinate=multiplication, YCoordinate=addition, ZCoordinate=panel_5)
panel_6 = Panel(pt)
item = ListItem(List=pt, Index=Slider(0, range=0..7), Wrap=True)
intcrv = Interpolate(Vertices=pt, Degree=Slider(3, range=1..3), Periodic=False, KnotStyle=1)  # -> Curve, Length, Domain
