# Grasshopper definition ejercicio3_s2_FabLabUNI.gh (Grasshopper 1.0.7)

dom = ConstructDomain(DomainStart=Slider(0, range=0..1), DomainEnd=Slider(2, range=0..2))
range = Range(Domain=dom, Steps=Slider(100, range=1..100))
panel = Panel(dom)
pi = Pi(Factor=range)
sin = Sine(Value=pi)
pt = ConstructPoint(XCoordinate=pi, YCoordinate=sin, ZCoordinate=0)
intcrv = Interpolate(Vertices=pt, Degree=3, Periodic=False, KnotStyle=1)  # -> Curve, Length, Domain
