# Grasshopper definition ejercicio5_s2_FabLabUNI.gh (Grasshopper 1.0.7)

series = Series(Start=Slider(0, range=0..1), Step=Slider(0.265, range=0..1), Count=Slider(50, range=0..50))
sin = Sine(Value=series)
cos = Cosine(Value=series)
pt = ConstructPoint(XCoordinate=series, YCoordinate=sin, ZCoordinate=cos)
intcrv = Interpolate(Vertices=pt, Degree=3, Periodic=False, KnotStyle=1)  # -> Curve, Length, Domain
