# Grasshopper definition ejercicio9_s2_FabLabUNI.gh (Grasshopper 1.0.7)

number_slider = Slider(30, range=0..100)
xz = XZPlane(Origin=Point(0, 0, 0))
rectangle = Rectangle(Plane=xz, XSize=number_slider, YSize=number_slider, Radius=0)  # -> Rectangle, Length

md_slider = MDSlider(
    SliderMode=0,
    slider_value=Point(0.5380928226, 0.7406900918, 0.5),
    x_domain=Domain(0, 1),
    y_domain=Domain(0, 1),
    z_domain=Domain(0, 1))
boundary = BoundarySurfaces(Edges=rectangle.Rectangle)
evalsrf = EvaluateSurface(Surface=reparameterize(boundary), Point=md_slider)  # -> Point, Normal, UDirection, VDirection, Frame

pop2d = Populate2D(Region=rectangle.Rectangle, Count=Slider(70, range=0..100), Seed=Slider(20, range=0..100))
voronoi = Voronoi(Points=pop2d, BruteForceOverride=False)

cp = ClosestPoint(Point=pop2d, Cloud=evalsrf.Point)  # -> ClosestPoint, CPIndex, Distance
bnd = Bounds(Numbers=cp.Distance)
dom = ConstructDomain(DomainStart=Slider(0.25, range=0..1), DomainEnd=Slider(0.81, range=0..1))
remap = RemapNumbers(Value=cp.Distance, Source=bnd, Target=dom)  # -> Mapped, Clipped

rint = RegionIntersection(CurvesA=voronoi, CurvesB=rectangle.Rectangle)
graft = GraftTree(Tree=rint, IncludeEmptyLists=True, IncludeNullItems=True)
scale = Scale(Geometry=rint, Center=pop2d, Factor=remap.Mapped)  # -> Geometry, Transform
multiplication = Multiplication(A=remap.Mapped, B=Slider(-5, range=-10..10))
Y = UnitY(Factor=multiplication)
move = Move(Geometry=scale.Geometry, Motion=Y)  # -> Geometry, Transform
graft_2 = GraftTree(Tree=move.Geometry, IncludeEmptyLists=True, IncludeNullItems=True)
boundary_2 = BoundarySurfaces(Edges=move.Geometry)
loft = Loft(
    Curves=[graft, graft_2],
    Options={Adjust=False, Closed=False, LoftEnds=0, LoftSimp=0, LoftType=0, Rebuild=10, Refit=0.01})

mesh = MeshBrep(
    Brep=loft,
    Settings={GridMaxCount=0, GridMinCount=16, JaggedSeams=False, MaxEdgeLength=0, MinEdgeLength=0.0001, MinTolerance=0, Refine=True, RefineAngle=0, RelativeTolerance=0.65, SimplePlanes=True, Tolerance=0})
mjoin = MeshJoin(Meshes=[mesh, boundary_2])
preview = CustomPreview(
    Geometry=mjoin,
    Material={diffuse=RGB(221, 160, 221), emission=RGB(66, 48, 66), shine=0.5, specular=RGB(255, 255, 255), transparency=0})
