# Grasshopper definition ejercicio1.gh (Grasshopper 1.0.7)

pt = ConstructPoint(XCoordinate=Slider(38.563, range=0..50), YCoordinate=Slider(40.988, range=0..50), ZCoordinate=0)
pt_2 = ConstructPoint(XCoordinate=Slider(7.204, range=0..50), YCoordinate=Slider(13.163, range=0..50), ZCoordinate=0)
ln = Line(StartPoint=pt_2, EndPoint=pt)
