# Grasshopper definition ejercicio2.gh (Grasshopper 1.0.7)

panel = Panel("""a
b
c
d
e""")
panel_2 = Panel("12345")
panel_3 = Panel("""a
b
c
d
e""")
panel_4 = Panel("hola")
panel_5 = Panel("""a
b
c
d
e""")
lng = ListLength(List=panel)
panel_6 = Panel(lng)
item = ListItem(List=panel_3, Index=Slider(1, range=0..4), Wrap=True)
subset = SubList(List=panel_5, Domain="1 to 3", Wrap=True)  # -> List, Index
panel_7 = Panel(item)
panel_8 = Panel(subset.List)
