# Grasshopper definition ejercicio3.gh (Grasshopper 1.0.7)

rectangle = Rectangle(Plane=PlaneXY(0, 0, 0), XSize=Slider(66, range=0..100), YSize=Slider(56, range=0..100), Radius=0)  # -> Rectangle, Length
pop2d = Populate2D(Region=rectangle.Rectangle, Count=Slider(73, range=0..100), Seed=Slider(27, range=0..100))
voronoi = Voronoi(Points=pop2d, Radius=Slider(8, range=0..10), Boundary=rectangle.Rectangle, BruteForceOverride=False)
panel = Panel(pop2d)
