# Grasshopper definition ejercicio4.gh (Grasshopper 1.0.7)

expression = Expression(x=Slider(0.25, range=0..1), Expression="sin(x)+cos(x)")
eval = Evaluate(F="sin(x)+cos(x)", x=Slider(0.25, range=0..1))
sin = Sine(Value="0.25")
cos = Cosine(Value="0.25")
addition = Addition(A=sin, B=cos)
panel = Panel(eval)
panel_2 = Panel(expression)
panel_3 = Panel(addition)
