# Grasshopper definition ejercicio5.gh (Grasshopper 1.0.7)

pi = Pi(Factor=Slider(1, range=0..1))
number_slider = Slider(100, range=0..100)
neg = Negative(Value=pi)
dom = ConstructDomain(DomainStart=neg, DomainEnd=pi)
range = Range(Domain=dom, Steps=number_slider)
range_2 = Range(Domain=dom, Steps=number_slider)
crossref = CrossReference(ListA=range, ListB=range_2, CrossMode=1)  # -> ListA, ListB
eval = Evaluate(F="(sinh(v)*cos(3*u))/(1+cosh(u)*cosh(v))", u=crossref.ListA, v=crossref.ListB)
eval_2 = Evaluate(F="(cosh(v)*sinh(u))/(1+cosh(u)*cosh(v))", u=crossref.ListA, v=crossref.ListB)
eval_3 = Evaluate(F="(sinh(v)*sin(3*u))/(1+cosh(u)*cosh(v))", u=crossref.ListA, v=crossref.ListB)
pt = ConstructPoint(XCoordinate=eval, YCoordinate=eval_2, ZCoordinate=eval_3)
srfgrid = SurfaceFromPoints(Points=pt, UCount=expr("x+1", number_slider), Interpolate=False)
scale = Scale(Geometry=srfgrid, Center=Point(0, 0, 0), Factor=Slider(30, range=0..100))  # -> Geometry, Transform
preview = CustomPreview(
    Geometry=scale.Geometry,
    Material={diffuse=RGB(221, 160, 221), emission=RGB(66, 48, 66), shine=0.5, specular=RGB(255, 255, 255), transparency=0})
