# Grasshopper definition esfera.gh (Grasshopper 1.0.7)
# plug-ins: Triceratops

nickname = RelativePath()
sph = Sphere(Base=PlaneXY(0, 0, 0), Radius=Slider(30, range=0..100))
basicmat = MeshBasicMaterial(Color=ColourSwatch(SwatchColor=RGB(177, 35, 255)))
mesh = Mesh(sph)
mesh_2 = Mesh(Mesh=mesh, Name="Ejemplo", Material=basicmat, DecimalAccuracy=3)
ambientlight = AmbientLight(Color=ColourSwatch(SwatchColor=RGB(255, 255, 255)), Intensity=Slider(0.502, range=0..1), Name="Ambient light")
button = Button()
scene = CompileScene(Objects=[mesh_2, ambientlight])
serialize = SerializeObject(Object3d=scene, Minify=False, Run=button)
concat = Concatenate(FragmentA=nickname, FragmentB="/www/assets")
concat_2 = Concatenate(FragmentA=nickname, FragmentB="/www")
writetxt = WriteTextFile(Path=concat, FileName="esfera.json", Data=serialize, Write=button)
http = HTTPServer(Path=concat_2, Run=Toggle(False))
