# Grasshopper definition esfera_textura.gh (Grasshopper 1.0.7)
# plug-ins: Triceratops

nickname = RelativePath()
concat = Concatenate(FragmentA=nickname, FragmentB="/materials/factory_brick_1k_jpg/factory_brick_diff_1k.jpg")
imgsettings = ImageSettings(Saturation=1, Contrast=Slider(0.367, range=-1..1), Lightness=0)
concat_2 = Concatenate(FragmentA=nickname, FragmentB="/materials/factory_brick_1k_jpg/factory_brick_nor_1k.jpg")
texture = Texture(ImagePath=concat_2)
texture_2 = Texture(ImagePath=concat, ImageSettings=imgsettings)
meshstandardmaps = MeshStandardMaterialMaps(Map=texture_2, AlphaTest=0.5, BumpScale=1, DisplacementScale=1, NormalMap=texture, EnvMapIntensity=1, AoMapIntensity=1)
sph = Sphere(Base=PlaneXY(0, 0, 0), Radius=Slider(30, range=0..100))
standardmat = MeshStandardMaterial(
    Color=RGB(255, 255, 255),
    Opacity=1,
    Roughness=Slider(0.7, range=0..1),
    Metalness=Slider(0.2, range=0..1),
    Emissive=RGB(0, 0, 0),
    EmissiveIntensity=1,
    Maps=meshstandardmaps)
mesh = Mesh(sph)
mesh_2 = Mesh(Mesh=mesh, Name="Ejemplo", Material=standardmat, DecimalAccuracy=3)
ambientlight = AmbientLight(Color=ColourSwatch(SwatchColor=RGB(255, 255, 255)), Intensity=Slider(0.502, range=0..1), Name="Ambient light")
button = Button()
scene = CompileScene(Objects=[mesh_2, ambientlight])
serialize = SerializeObject(Object3d=scene, Minify=False, Run=button)
concat_3 = Concatenate(FragmentA=nickname, FragmentB="/www/assets")
concat_4 = Concatenate(FragmentA=nickname, FragmentB="/www")
writetxt = WriteTextFile(Path=concat_3, FileName="esfera.json", Data=serialize, Write=button)
http = HTTPServer(Path=concat_4, Run=Toggle(False))
